# Dynamo graph CLASSES CATEGORIES FAMILIES TYPES AND INSTANCES.dyn (Dynamo 2.18.1.5096)
# packages: GenerativeDesign.Revit 6.0.2.0

select_family_instance = DSModelFamilyInstanceSelection()  # 1 picked in the model
watch = Watch(select_family_instance)
categories = Categories("OST_StructuralColumns")
watch_2 = Watch(categories)
family_types = FamilyTypes("Structural Column Tag:Structural Column Tag")
watch_3 = Watch(family_types)
element_classes = ElementTypes("StructuralConnectionType")
all_elements_of_class = ElementsOfType(element_class=element_classes)
watch_4 = Watch(all_elements_of_class)
watch_5 = Watch(element_classes)
watch_6 = Watch()  # unwired: arg0
