# Dynamo graph Home.dyn (Dynamo 2.18.1.5096)

number = DoubleInput(0)
integer_slider = IntegerSlider(16, range=0..100 step 1)
number_slider = DoubleSlider(4.7, range=0..100 step 0.1)
sequence = Sequence(start=number, amount=integer_slider, step=number_slider)
byCoordinates = Point.ByCoordinates(x=sequence, y=sequence)
number_2 = DoubleInput(2)
mul = number_slider * number_2
byCenterPointRadius = Circle.ByCenterPointRadius(centerPoint=byCoordinates, radius=mul@@L1)
watch = Watch(byCenterPointRadius)
number_3 = DoubleInput(0)
integer_slider_2 = IntegerSlider(16, range=0..100 step 1)
number_slider_2 = DoubleSlider(4.7, range=0..100 step 0.1)
sequence_2 = Sequence(start=number_3, amount=integer_slider_2, step=number_slider_2)
byCoordinates_2 = Point.ByCoordinates(x=sequence_2, y=sequence_2)
number_4 = DoubleInput(2)
mul_2 = number_slider_2 * number_4
byCenterPointRadius_2 = Circle.ByCenterPointRadius(centerPoint=byCoordinates_2, radius=mul_2@@L1)
watch_2 = Watch(byCenterPointRadius_2)
