# Dynamo graph REVIT AND DYNAMO.dyn (Dynamo 2.18.1.5096)

select_model_element = DSModelElementSelection()  # 1 picked in the model
faces = Element.Faces(element=select_model_element)
watch = Watch(faces)
watch_2 = Watch(select_model_element)
geometry = Element.Geometry(element=watch_2)
explode = Geometry.Explode(geometry=geometry)
watch_3 = Watch(explode)
explode_2 = Geometry.Explode()  # unwired: geometry
watch_4 = Watch(explode_2)
select_face = DSFaceSelection()  # 1 picked in the model
watch_5 = Watch(select_face)
select_faces = SelectFaces()  # 4 picked in the model
watch_6 = Watch(geometry)
watch_3d = Watch3D(geometry)
categories = Categories("OST_Levels")
all_elements_of_category = ElementsOfCategory(Category=categories)
watch_7 = Watch(all_elements_of_category)
faces_2 = Element.Faces(element=watch_7)
watch_8 = Watch(faces_2)
watch_9 = Watch()  # unwired: arg0
getFamily = FamilyInstance.GetFamily()  # unwired: familyInstance
byFamilyType = FamilyInstance.ByFamilyType()  # unwired: familyType
watch_10 = Watch()  # unwired: arg0
code_block = CodeBlock { "Family"; }
getParameterValueByName = Element.GetParameterValueByName(element=select_model_element, parameterName=code_block)
watch_11 = Watch(getParameterValueByName)
explode_3 = Geometry.Explode()  # unwired: geometry
all_elements_of_family_type = ElementsOfFamilyType(Family_Type=getParameterValueByName)
watch_12 = Watch(all_elements_of_family_type)
geometry_2 = Element.Geometry(element=watch_12)
watch_3d_2 = Watch3D(geometry_2)
explode_4 = Geometry.Explode(geometry=geometry_2)
watch_3d_3 = Watch3D(explode_4)
watch_13 = Watch(geometry_2)
watch_14 = Watch(explode_4)
code_block_2 = CodeBlock { [1]; }
getItemAtIndex = List.GetItemAtIndex(list=watch_14, index=code_block_2)
watch_3d_4 = Watch3D(getItemAtIndex)
