# Dynamo graph USING PYTHON FOR RESULTS.dyn (Dynamo 2.18.1.5096)

python_script = Python()  # CPython3; unwired: IN[0]
# ---------- python_script.python (26 lines) ----------
# Import Dynamo Revit libraries

import clr
clr.AddReference('RevitAPI')
from Autodesk.Revit.DB import FilteredElementCollector, BuiltInCategory, BuiltInParameter

# Import Dynamo Revit DocumentManager
clr.AddReference('RevitServices')
from RevitServices.Persistence import DocumentManager

# Get the active Revit document from the current Dynamo Revit model
doc = DocumentManager.Instance.CurrentDBDocument

# Define a category for all elements (Generic Models category)
category = BuiltInCategory.OST_Walls

# Create a filtered element collector to get all instances of the specified category
collector = FilteredElementCollector(doc).OfCategory(category).WhereElementIsNotElementType()

instance_name = []
# Iterate through the instances and print their names
for instance in collector:
    instance_name_param = instance.get_Parameter(BuiltInParameter.ALL_MODEL_MARK)
    instance_name.append(instance)
       
   
# ----------------------------------------
python_script_2 = Python()  # CPython3; unwired: IN[0]
# ---------- python_script_2.python (29 lines) ----------
import clr
clr.AddReference('RevitAPI')
from Autodesk.Revit.DB import FilteredElementCollector, BuiltInCategory

# Import Dynamo Revit DocumentManager
clr.AddReference('RevitServices')
from RevitServices.Persistence import DocumentManager

# Get the active Revit document from the current Dynamo Revit model
doc = DocumentManager.Instance.CurrentDBDocument

# Define a category for all elements (Generic Models category)
category = BuiltInCategory.OST_Walls

# Create a filtered element collector to get all instances of the specified category
collector = FilteredElementCollector(doc).OfCategory(category).WhereElementIsNotElementType()

# Get the first element in the collector (you can modify this as needed)
first_element = collector.FirstElement()

arrayEl =[]
# Print all parameter names and values for the first element
if first_element:
    for param in first_element.Parameters:
        param_name = param.Definition.Name
        param_value = param.AsValueString()
        arrayEl.append(param_value)
        
OUT=arrayEl
# ----------------------------------------
watch = Watch(python_script_2)
