# Dynamo graph Youtube video follow ups.dyn (Dynamo 2.18.1.5096)
# packages: Synthesize toolkit 23.11.2102, Genius Loci 2023.7.13

element_classes = ElementTypes("Wall")
all_elements_of_class = ElementsOfType(element_class=element_classes)
watch = Watch(all_elements_of_class)
getElementsData = SynthesizeToolkit.Revit.Select.GetElementsData(Elements=all_elements_of_class)
watch_2 = Watch(getElementsData.Element)
code_block = CodeBlock { "Area"; }
getParameterValueByName = Element.GetParameterValueByName(element=watch_2, parameterName=code_block)
watch_3 = Watch(getParameterValueByName)
code_block_2 = CodeBlock { 800; }
watch_4 = Watch()  # unwired: arg0
element_parameters_properties = Custom[Element Parameters Properties]()  # package Genius Loci; Retrieves all the properties of the parameters from a given element in the active or given document.; unwired: element
parameters = Element.Parameters(element=all_elements_of_class)
watch_5 = Watch(parameters)
code_block_3 = CodeBlock(list=watch_5) { list[0][0]; }
watch_6 = Watch(code_block_3)
code_block_4 = CodeBlock { 900; }
setValue = Parameter.SetValue(parameter=watch_6, value=code_block_4)
