# Dynamo graph boolean mash.dyn (Dynamo 2.18.1.5096)

boolean = BoolSelector(true)
code_block = CodeBlock { "This is the result if true"; }
code_block_2 = CodeBlock { Math.PI; }
if_ = RefactoredIf(test=boolean, true=code_block, false=code_block_2)
watch = Watch(if_)
formula = Formula("If(x,y,z)", x=boolean, y=code_block, z=code_block_2)
watch_2 = Watch(formula)
code_block_3 = CodeBlock(x=boolean, y=code_block, z=code_block_2) { (x?y:z); }
watch_3 = Watch(code_block_3)
