# Dynamo graph circle distribution.dyn (Dynamo 2.18.1.5096)

number = DoubleInput(0)
number_2 = DoubleInput(10)
number_3 = DoubleInput(1)
sequence = Sequence(start=number, amount=number_2, step=number_3)
number_4 = DoubleInput(0)
number_5 = DoubleInput(10)
number_6 = DoubleInput(1)
sequence_2 = Sequence(start=number_4, amount=number_5, step=number_6)
list_create = List.Create(item0=sequence, item1=sequence_2)
watch = Watch(sequence)
watch_2 = Watch(sequence_2)
byCoordinates = Point.ByCoordinates()
watch_3 = Watch()  # unwired: arg0
