# Dynamo graph circle radius and center point FIRST LOFT.dyn (Dynamo 2.18.1.5096)

code_block = CodeBlock { 15; }
byCoordinates = Point.ByCoordinates(z=code_block)
code_block_2 = CodeBlock { 10; }
byCoordinates_2 = Point.ByCoordinates(x=code_block_2)
code_block_3 = CodeBlock(a=code_block_2) { a*2; }
byCoordinates_3 = Point.ByCoordinates(x=code_block_3, z=code_block)
code_block_4 = CodeBlock(a=code_block_2) { a*3; }
byCoordinates_4 = Point.ByCoordinates(x=code_block_4)
code_block_5 = CodeBlock(a=code_block_2) { a*4; }
byCoordinates_5 = Point.ByCoordinates(x=code_block_5, z=code_block)
list_create = List.Create(item0=byCoordinates, item1=byCoordinates_2, item2=byCoordinates_3, item3=byCoordinates_4, item4=byCoordinates_5)
code_block_6 = CodeBlock { 2; }
byPoints = NurbsCurve.ByPoints(points=list_create, degree=code_block_6)
code_block_7 = CodeBlock(h=code_block) { h/2; }
byCoordinates_6 = Point.ByCoordinates(y=code_block_3, z=code_block_7)
byCoordinates_7 = Point.ByCoordinates(x=code_block_2, y=code_block_3, z=code_block)
byCoordinates_8 = Point.ByCoordinates(x=code_block_3, y=code_block_3, z=code_block_7)
byCoordinates_9 = Point.ByCoordinates(x=code_block_4, y=code_block_3, z=code_block)
byCoordinates_10 = Point.ByCoordinates(x=code_block_5, y=code_block_3, z=code_block_7)
list_create_2 = List.Create(item0=byCoordinates_6, item1=byCoordinates_7, item2=byCoordinates_8, item3=byCoordinates_9, item4=byCoordinates_10)
code_block_8 = CodeBlock { 2; }
byPoints_2 = NurbsCurve.ByPoints(points=list_create_2, degree=code_block_8)
translate = Geometry.Translate(geometry=byPoints, yTranslation=code_block_5)
list_create_3 = List.Create(item0=byPoints, item1=byPoints_2, item2=translate)
byLoft = PolySurface.ByLoft(crossSections=list_create_3)
