# Dynamo graph circle radius and center point concentric.dyn (Dynamo 2.18.1.5096)

number = DoubleInput(0)
number_2 = DoubleInput(10)
number_3 = DoubleInput(2)
sequence = Sequence(start=number, amount=number_2, step=number_3)
byCoordinates = Point.ByCoordinates(x=sequence@L1, y=sequence@L1)  # graph output
python_script = Python(IN[0]=byCoordinates)  # CPython3
# ---------- python_script.python (18 lines) ----------
# Get the input list from Dynamo
inputList = IN[0]

# Define a function to flatten nested lists
def flatten(lst):
    flat_list = []
    for item in lst:
        if isinstance(item, list):
            flat_list.extend(flatten(item))
        else:
            flat_list.append(item)
    return flat_list

# Flatten the input list
flattenedList = flatten(inputList)

# Output the flattened list
OUT = flattenedList
# ----------------------------------------
number_slider = DoubleSlider(10.886, range=0..100 step 0.1)
number_slider_2 = DoubleSlider(9.202, range=0..100 step 0.1)
byCoordinates_2 = Point.ByCoordinates(x=number_slider, y=number_slider_2)
distanceTo = Geometry.DistanceTo(geometry=python_script@L1, other=byCoordinates_2)
number_slider_3 = DoubleSlider(22.6, range=0..100 step 0.1)
code_block = CodeBlock(x=distanceTo, y=number_slider_3) { x/y; }
byCenterPointRadius = Circle.ByCenterPointRadius(centerPoint=python_script, radius=code_block@@L1)
watch = Watch(byCenterPointRadius)
