# Dynamo graph circle radius and center point.dyn (Dynamo 2.18.1.5096)

number = DoubleInput(10)
number_2 = DoubleInput(10)
byCoordinates = Point.ByCoordinates(x=number@L1, y=number_2@L1)  # graph output
python_script = Python(IN[0]=byCoordinates)  # CPython3
# ---------- python_script.python (18 lines) ----------
# Get the input list from Dynamo
inputList = IN[0]

# Define a function to flatten nested lists
def flatten(lst):
    flat_list = []
    for item in lst:
        if isinstance(item, list):
            flat_list.extend(flatten(item))
        else:
            flat_list.append(item)
    return flat_list

# Flatten the input list
flattenedList = flatten(inputList)

# Output the flattened list
OUT = flattenedList
# ----------------------------------------
number_slider = DoubleSlider(2, range=0..100 step 0.1)
number_slider_2 = DoubleSlider(2, range=0..100 step 0.1)
byCoordinates_2 = Point.ByCoordinates(x=number_slider, y=number_slider_2)
distanceTo = Geometry.DistanceTo(geometry=byCoordinates@L1, other=byCoordinates_2)
byCenterPointRadius = Circle.ByCenterPointRadius(centerPoint=python_script, radius=distanceTo@@L1)
watch = Watch(byCenterPointRadius)
