# Dynamo graph coordinate points.dyn (Dynamo 2.18.1.5096)

number = DoubleInput(0)
number_2 = DoubleInput(10)
number_3 = DoubleInput(1)
sequence = Sequence(start=number, amount=number_2, step=number_3)
number_4 = DoubleInput(0)
number_5 = DoubleInput(10)
number_6 = DoubleInput(1)
sequence_2 = Sequence(start=number_4, amount=number_5, step=number_6)
python_script = Python(IN[0]=sequence, IN[1]=sequence_2)  # CPython3
# ---------- python_script.python (19 lines) ----------
list1 = IN[0]
list2 =IN[1]

def cartesian_product(list1, list2):
    result = []

    for elem1 in list1:
        for elem2 in list2:
            result.append((elem1, elem2))

    return result

# Example usage


# Get Cartesian product of list1 and list2
cartesian_points = cartesian_product(list1, list2)

OUT = cartesian_points
# ----------------------------------------
watch = Watch(python_script)
list_create = List.Create(item0=sequence, item1=sequence_2)
number_slider = DoubleSlider(4, range=0..100 step 0.1)
byCenterPointRadius = Circle.ByCenterPointRadius(radius=number_slider)
number_slider_2 = DoubleSlider(8, range=0..100 step 0.1)
byCenterPointRadius_2 = Circle.ByCenterPointRadius(radius=number_slider_2)
number_slider_3 = DoubleSlider(20, range=0..100 step 0.1)
code_block = CodeBlock(x=number_slider_3) { x*0.3; }
translate = Geometry.Translate(geometry=byCenterPointRadius_2, zTranslation=code_block)
number_slider_4 = DoubleSlider(3, range=0..100 step 0.1)
byCenterPointRadius_3 = Circle.ByCenterPointRadius(radius=number_slider_4)
code_block_2 = CodeBlock(x=number_slider_3) { x*0.7; }
translate_2 = Geometry.Translate(geometry=byCenterPointRadius_3, zTranslation=code_block_2)
number_slider_5 = DoubleSlider(2, range=0..100 step 0.1)
byCenterPointRadius_4 = Circle.ByCenterPointRadius(radius=number_slider_5)
translate_3 = Geometry.Translate(geometry=byCenterPointRadius_4, zTranslation=number_slider_3)
list_create_2 = List.Create(item0=byCenterPointRadius, item1=translate, item2=translate_2, item3=translate_3)
byLoft = Surface.ByLoft(crossSections=list_create_2)
byLoft_2 = Surface.ByLoft()  # unwired: crossSections, guideCurves
