# Dynamo graph dynamo book exercises.dyn (Dynamo 2.18.1.5096)

number = DoubleInput(0)
number_2 = DoubleInput(0)
number_3 = DoubleInput(0)
sequence = Sequence(start=number, amount=number_2, step=number_3)
byCoordinates = Point.ByCoordinates(x=sequence, y=sequence)
flatten = List.Flatten(list=byCoordinates)
watch = Watch(flatten)
watch_2 = Watch(sequence)
watch_3 = Watch(byCoordinates)
number_4 = DoubleInput(0)
number_5 = DoubleInput(10)
number_6 = DoubleInput(2)
sequence_2 = Sequence(start=number_4, amount=number_5, step=number_6)
byCoordinates_2 = Point.ByCoordinates(x=sequence_2, y=sequence_2)
flatten_2 = List.Flatten(list=byCoordinates_2)
number_slider = DoubleSlider(8.3, range=0..100 step 0.1)
number_slider_2 = DoubleSlider(9.202, range=0..100 step 0.1)
byCoordinates_3 = Point.ByCoordinates(x=number_slider, y=number_slider_2)
distanceTo = Geometry.DistanceTo(geometry=flatten_2, other=byCoordinates_3)
byCenterPointRadius = Circle.ByCenterPointRadius(centerPoint=flatten_2, radius=distanceTo)
number_slider_3 = DoubleSlider(2.5, range=0..100 step 0.1)
code_block = CodeBlock { x/y; }  # unwired: x, y
number_7 = DoubleInput(0)
number_8 = DoubleInput(10)
number_9 = DoubleInput(5)
sequence_3 = Sequence(start=number_7, amount=number_8, step=number_9)
watch_4 = Watch(sequence_3)
number_10 = DoubleInput(0)
number_11 = DoubleInput(10)
number_12 = DoubleInput(5)
sequence_4 = Sequence(start=number_10, amount=number_11, step=number_12)
watch_5 = Watch(sequence_4)
list_create = List.Create(item0=sequence_3, item1=sequence_4)
watch_6 = Watch(list_create)
python_script = Python(IN[0]=list_create)  # CPython3
# ---------- python_script.python (9 lines) ----------
listAll = IN[0]
concatenated_subarray=[]

for i,item1 in enumerate(listAll):
    subArray = listAll[i]
    for j,item2 in enumerate(subArray):
       concatenated_subarray.append([i,item2])  
        
OUT = concatenated_subarray
# ----------------------------------------
byCoordinates_4 = Point.ByCoordinates(x=python_script, y=python_script)
number_slider_4 = DoubleSlider(38.2, range=0..100 step 0.1)
byCenterPointRadius_2 = Circle.ByCenterPointRadius(centerPoint=byCoordinates_4, radius=number_slider_4)
watch_7 = Watch(python_script)
watch_8 = Watch(list_create)
watch_9 = Watch(byCoordinates_2)
