# Dynamo graph families.dyn (Dynamo 2.18.1.5096)

select_model_element = DSModelElementSelection()  # 1 picked in the model
code_block = CodeBlock { "Family"; }
getParameterValueByName = Element.GetParameterValueByName(element=select_model_element, parameterName=code_block)
watch = Watch(getParameterValueByName)
all_elements_of_family_type = ElementsOfFamilyType(Family_Type=getParameterValueByName)
watch_2 = Watch(all_elements_of_family_type)
geometry = Element.Geometry(element=all_elements_of_family_type)
watch_3 = Watch(geometry)
explode = Geometry.Explode(geometry=geometry)
watch_4 = Watch(explode)
parameters = Element.Parameters(element=select_model_element)
watch_5 = Watch(parameters)
select_model_element_2 = DSModelElementSelection()  # 1 picked in the model
