# Dynamo graph get parameter value CUSTOM METHOD.dyn (Dynamo 2.18.1.5096)
# packages: GenerativeDesign.Revit 6.0.2.0

# group: GET VALUE FROM FAMILY
select_family_instance = DSModelFamilyInstanceSelection()  # 1 picked in the model; frozen
name = Element.Name(element=select_family_instance)
byName = FamilyType.ByName(name=name)
family = FamilyType.Family(familyType=byName)
familyDocument = Family.FamilyDocument(family=family)
name_2 = Space.Name(space=byName)
get_family_parameter = FamilyInstanceParameters(f=select_family_instance)  # nothing selected
getParameterValueByName = FamilyDocument.GetParameterValueByName(familyDocument=familyDocument, familyTypeName=name_2, parameterName=get_family_parameter)
watch = Watch(getParameterValueByName)
watch_2 = Watch(byName)

# group: CHECK UPDATE, WHY 14.40 IN2 NOT 15IN2
parameterByName = Parameter.ParameterByName(element=byName, name=get_family_parameter)
watch_3 = Watch(parameterByName)

# group: SET UPDATE OF PARAMETER VALUE
code_block = CodeBlock { 15; }  # frozen
setParameterValueByName = FamilyDocument.SetParameterValueByName(familyDocument=familyDocument, familyTypeName=name_2, parameter=get_family_parameter, value=code_block)

categories = Categories("OST_Doors")  # frozen
all_elements_of_category = ElementsOfCategory(Category=categories)
view_family_types = ViewFamilyTypes("3D View")
byFamilyType = FamilyInstance.ByFamilyType()  # frozen; unwired: familyType
watch_4 = Watch(byFamilyType)
views = Views("Structure Only")  # frozen
all_elements_of_category_in_view = ElementsOfCategoryInView(Category=categories, View=views)
watch_5 = Watch(all_elements_of_category_in_view)
all_elements_in_active_view = ElementsInView()
levels = Levels("L1_37_Med")  # frozen
all_elements_at_level = ElementsAtLevel(Level=levels)
watch_6 = Watch(all_elements_at_level)

# group: FOR STUDYING
levels_2 = Levels("L1_35_Low")
all_elements_at_level_2 = ElementsAtLevel(Level=levels_2)
watch_7 = Watch(all_elements_at_level_2)
code_block_2 = CodeBlock(elements=watch_6) { elements[0..1429]; }  # frozen
watch_8 = Watch(code_block_2)
getCategory = Element.GetCategory(element=watch_8)
watch_9 = Watch(getCategory)
elementType = Element.ElementType(element=watch_6)  # frozen
familyName = ElementType.FamilyName(elementType=elementType)
watch_10 = Watch(familyName)
code_block_3 = CodeBlock(original_List=watch_10) { original_List; section1 = original_List[64..89]; section2 = original_List[91..99]; }
join = List.Join(list0=code_block_3.section1, list1=code_block_3.section2)
watch_11 = Watch(join)
watch_12 = Watch(elementType)

# group: Get Parameter value from using family types
name_3 = Family.Name(family=watch_6)
watch_13 = Watch(name_3)
python_script = Python(IN[0]=watch_13)  # CPython3
# ---------- python_script.python (13 lines) ----------
import re
pattern = '^W'

matching_array=[]

array =IN[0]

for i in array:
    if isinstance(i,str) and re.match(pattern,i):
        matching_array.append(i)
OUT=matching_array
        
        
# ----------------------------------------
watch_14 = Watch(python_script)
byName_2 = FamilyType.ByName(name=watch_14)
watch_15 = Watch(byName_2)
family_2 = FamilyType.Family(familyType=watch_15)
familyDocument_2 = Family.FamilyDocument(family=family_2)
get_family_parameter_2 = FamilyInstanceParameters(f=watch_15)  # nothing selected
name_4 = Parameter.Name(parameter=get_family_parameter_2)
getParameterValueByName_2 = FamilyDocument.GetParameterValueByName(familyDocument=familyDocument_2, familyTypeName=watch_14, parameterName=name_4)
watch_16 = Watch(getParameterValueByName_2)
