# Dynamo graph levels and scope boxes.dyn (Dynamo 2.18.1.5096)

code_block = CodeBlock { "Scope Boxes"; }
byName = Category.ByName(name=code_block)
watch = Watch(byName)
all_elements_of_category = ElementsOfCategory(Category=byName)
code_block_2 = CodeBlock { "Name"; }
getParameterValueByName = Element.GetParameterValueByName(element=all_elements_of_category, parameterName=code_block_2)
watch_2 = Watch(getParameterValueByName)
watch_3 = Watch(all_elements_of_category)
code_block_3 = CodeBlock { "Levels"; }
byName_2 = Category.ByName(name=code_block_3)
watch_4 = Watch(byName_2)
all_elements_of_category_2 = ElementsOfCategory(Category=byName_2)
name = Level.Name(level=all_elements_of_category_2)
watch_5 = Watch(name)
watch_6 = Watch(all_elements_of_category_2)
python_script = Python(IN[0]=name, IN[1]=getParameterValueByName)  # CPython3
# ---------- python_script.python (13 lines) ----------
# Example lists
list1 = IN[0]
list2 = IN[1]

# Convert list2 elements to strings for concatenation
list2 = [str(item) for item in list2]

# Concatenate two lists and return the second element for each element in the first list
result_list = [[item1 + "-" + item2 for item2 in list2] for item1 in list1]


# Output the result
OUT = result_list
# ----------------------------------------
watch_7 = Watch(python_script)
