# Dynamo graph lists.dyn (Dynamo 2.18.1.5096)

code_block = CodeBlock { 0..20..#4; 20; }
byCoordinates = Point.ByCoordinates(x=code_block.out0)
byCoordinates_2 = Point.ByCoordinates(x=code_block.out0, y=code_block.out1)
byStartPointEndPoint = Line.ByStartPointEndPoint(startPoint=byCoordinates, endPoint=byCoordinates_2)
watch = Watch(byStartPointEndPoint)
combine = List.Combine()  # unwired: combineFunction, list0, list1
watch_2 = Watch()  # unwired: arg0
code_block_2 = CodeBlock { 0..1..#3; 0..1..#4; 0..1..#5; 0..1..#6; }
list_create = List.Create(item0=code_block_2.out0, item1=code_block_2.out1, item2=code_block_2.out2, item3=code_block_2.out3)
watch_3 = Watch(list_create)
pointAtParameter = Curve.PointAtParameter(curve=byStartPointEndPoint, param=watch_3)
watch_4 = Watch(pointAtParameter)
code_block_3 = CodeBlock { 100; }
byWidthLength = Rectangle.ByWidthLength(width=code_block_3, length=code_block_3)
byPatch = Surface.ByPatch(closedCurve=byWidthLength)
code_block_4 = CodeBlock { 0..1..#15; 0..1..#5; }
pointAtParameter_2 = Surface.PointAtParameter(surface=byPatch, u=code_block_4.out0, v=code_block_4.out1, lacing=CrossProduct)
watch_5 = Watch(pointAtParameter_2)
code_block_5 = CodeBlock { 1; }
getItemAtIndex = List.GetItemAtIndex(list=watch_5, index=code_block_5)
code_block_6 = CodeBlock { 2; }
code_block_7 = CodeBlock(points=watch_5) { points[1][2]; }
code_block_8 = CodeBlock { 20; }
translate = Geometry.Translate(geometry=code_block_7, zTranslation=code_block_8)
replaceItemAtIndex = List.ReplaceItemAtIndex(list=getItemAtIndex, index=code_block_6, item=translate)
watch_6 = Watch(replaceItemAtIndex)
watch_7 = Watch(translate)
code_block_9 = CodeBlock { 1; }
replaceItemAtIndex_2 = List.ReplaceItemAtIndex(list=watch_5, index=code_block_9, item=replaceItemAtIndex)
byPoints = NurbsCurve.ByPoints(points=replaceItemAtIndex_2)
watch_8 = Watch(byPoints)
watch_9 = Watch(replaceItemAtIndex_2)
byLoft = Surface.ByLoft(crossSections=byPoints)
code_block_10 = CodeBlock { x_vals = 0..1; y_vals = -3..-7; Point.ByCoordinates(x_vals<1>, y_vals<2>); Point.ByCoordinates(x_vals<2>, y_vals<1>); }
watch_10 = Watch(code_block_10.out2)
watch_11 = Watch(code_block_10.out3)
number_slider = DoubleSlider(1, range=0..100 step 0.1)
number_slider_2 = DoubleSlider(1, range=0..100 step 0.1)
number_slider_3 = DoubleSlider(1, range=0..100 step 0.1)
range = Range(start=number_slider, end=number_slider_2, step=number_slider_3)
byCoordinates_3 = Point.ByCoordinates(x=range, y=range, z=range)
Z = Point.Z(point=byCoordinates_3)
number_slider_4 = DoubleSlider(1, range=0..100 step 0.1)
div = Z / number_slider_4
byLengths = Cuboid.ByLengths(width=div, length=div, height=div)
code_block_11 = CodeBlock()
# ---------- code_block_11.designscript (5 lines) ----------
t1={t2..t3..t4);
plane1=Point.ByCoordinates(t1<1>,t1<2>,t1<3>);
t5 = plane1.Z;
t6 = t5/t7;
polygon1 = Cuboid.ByLengths(plane1, t6, t6, t6);
# ----------------------------------------
number_slider_5 = DoubleSlider(1, range=0..100 step 0.1)
number_slider_6 = DoubleSlider(1, range=0..100 step 0.1)
code_block_12 = CodeBlock(x=number_slider_5, y=number_slider_6) { refPt=Point.ByCoordinates(x,y,0); coordsXY=(-50..50..#11); gridPts=Point.ByCoordinates(coordsXY<1>, coordsXY<2>,0); }
watch_12 = Watch(code_block_12.gridPts)
