# Dynamo graph more to learn.dyn (Dynamo 2.18.1.5096)
# packages: Sweco SEALQG 1.1.1, Synthesize toolkit 23.11.2102, Genius Loci 2023.7.13

python_script = Python()  # CPython3; unwired: IN[0]
# ---------- python_script.python (19 lines) ----------
# Load the Python Standard and DesignScript Libraries
import clr
clr.AddReference('RevitServices')
clr.AddReference('RevitAPI')
clr.AddReference('RevitAPIUI')
import RevitServices
from RevitServices.Persistence import DocumentManager

# Place your code below this line
doc = DocumentManager.Instance.CurrentDBDocument
uiapp = DocumentManager.Instance.CurrentUIApplication
app = uiapp.Application

OUT = [doc, uiapp, app]



# Assign your output to the OUT variable.
OUT = 0
# ----------------------------------------
watch = Watch(python_script)
code_block = CodeBlock { "Walls"; }
element_classes = ElementTypes("Wall")
all_elements_of_class = ElementsOfType(element_class=element_classes)
family_types = FamilyTypes("Wall Tag:1/2\"")
setType = Custom[SetType](element=all_elements_of_class, type=family_types)  # package Sweco SEALQG
watch_2 = Watch(setType)
newElementType = SynthesizeToolkit.Revit.Elements.NewElementType(Family=setType)  # unwired: TypeName
watch_3 = Watch(newElementType)
getDocumentCategory = SynthesizeToolkit.Revit.Document.GetDocumentCategory()
watch_4 = Watch(getDocumentCategory.IsFamily)
family_types_2 = FamilyTypes("Concrete-Rectangular Beam:CB24x39")
family = FamilyType.Family(familyType=family_types_2)
all_elements_of_family = Custom[All Elements of Family](family=family)  # package Genius Loci; Get the family instances of the given loadable family.
watch_5 = Watch(all_elements_of_family)
create_familydocument = Custom[Create FamilyDocument]()  # package Genius Loci; Creates a new familyDocument from a family template file (.rft); unwired: filePath
family_properties = Custom[Family Properties](family=family)  # package Genius Loci; Queries the family properties. (IsInPlace, IsShared...)
watch_6 = Watch(family_properties.Category)
watch_7 = Watch(family_properties.Name)
watch_8 = Watch(family_properties.PlacementType)
watch_9 = Watch(family_properties.HasRoomCalculationPoint)
watch_10 = Watch(family_properties.IsInPlace)
watch_11 = Watch(family_properties.IsShared)
watch_12 = Watch(family_properties.HostingBehavior)
all_elements_of_system = Custom[All Elements of System]()  # package Genius Loci; Returns every element of the duct or piping network, including ducts, pipes, fittings, fixtures, equipments etc.; unwired: system
categories = Categories("OST_Floors")
all_elements_of_category = ElementsOfCategory(Category=categories)
element_getloadablefamily = Custom[Element GetLoadableFamily](element=all_elements_of_category)  # package Genius Loci; Get the loadable family from the given element.
all_elements_of_family_2 = Custom[All Elements of Family](family=element_getloadablefamily.Family)
watch_13 = Watch(all_elements_of_family_2)
watch_14 = Watch(element_getloadablefamily.FamilyName)
watch_15 = Watch(all_elements_of_category)
get_alldocuments = Custom[Get AllDocuments]()  # package Genius Loci; Get documents (linked and opened in background). The first document is the active document.
watch_16 = Watch(get_alldocuments.FileName)
all_elements_of_family_3 = Custom[All Elements of Family]()  # unwired: family
watch_17 = Watch(get_alldocuments.Document)
code_block_2 = CodeBlock(list=watch_17) { list[0]; }
getDocumentCategory_2 = SynthesizeToolkit.Revit.Document.GetDocumentCategory(Document=code_block_2)
all_elements_of_category_2 = ElementsOfCategory(Category=getDocumentCategory_2.Category)
element_getloadablefamily_2 = Custom[Element GetLoadableFamily](element=all_elements_of_category_2)
watch_18 = Watch(element_getloadablefamily_2.FamilyName)
watch_19 = Watch(code_block_2)
watch_20 = Watch(getDocumentCategory_2.IsFamily)
watch_21 = Watch(element_getloadablefamily_2.Family)
getElementsData = SynthesizeToolkit.Revit.Select.GetElementsData(Elements=all_elements_of_category_2)
watch_22 = Watch(getElementsData.Element)
familyinstance_byreference = Custom[FamilyInstance ByReference]()  # package Genius Loci; Inserts a new instance of the given family type onto a face (or Reference Plane) referenced by the input Reference, using a location and a reference direction. Note : The FamilyPlacementType must be WorkPlane Based. The reference direction defines the rotation of the instance on the face and thus can't be parallel to the face normal.; unwired: familyType, reference, location, referenceDirection
familyinstance_byreference_2 = Custom[FamilyInstance ByReference]()  # unwired: familyType, reference, location, referenceDirection
familydocument_load = Custom[FamilyDocument Load](familyDocument=watch_17)  # package Genius Loci; Load the family as familyDocument, existing family will be overwritten. Use the "FamilyDocument Close" node to close the familyDocument.
watch_23 = Watch(familydocument_load)
categories_2 = Categories("OST_Walls")
watch_24 = Watch()  # unwired: arg0
code_block_3 = CodeBlock(list=watch_17) { list[0]; }
