# Dynamo graph occupancy code.dyn (Dynamo 2.18.1.5096)
# packages: bimorphNodes 4.2.4, Genius Loci 2023.7.13, Rhythm 2023.9.1, Synthesize toolkit 23.11.2102

element_classes = ElementTypes("Room")
all_elements_of_class = ElementsOfType(element_class=element_classes)
watch = Watch(all_elements_of_class)
code_block = CodeBlock { "Area"; }
getParameterValueByName = Revit.LinkElement.GetParameterValueByName(linkElement=all_elements_of_class, parameterName=code_block)
watch_2 = Watch(getParameterValueByName)
directory_path = Directory("C:\Users\edsaj\OneDrive\Desktop\dynamo projects\dynrevupd")
directory_from_path = DirectoryObject(path=directory_path)
code_block_2 = CodeBlock { ".rfa"; false; }
getDirectoryContents = FileSystem.GetDirectoryContents(directory=directory_from_path, searchString=code_block_2.out0, includeSubdirectories=code_block_2.out1)
ʳʰʸᵗʰᵐ_applications = Rhythm.Revit.Application.Applications.OpenDocumentFile(filePath=getDirectoryContents.directories)
code_block_3 = CodeBlock { "Occupancy"; }
python_script = Python(IN[0]=ʳʰʸᵗʰᵐ_applications, IN[1]=code_block_3)  # CPython3
# ---------- python_script.python (56 lines) ----------
# Import necessary Dynamo libraries
import clr
clr.AddReference('RevitAPI')
from Autodesk.Revit.DB import FilteredElementCollector, BuiltInCategory, Transaction

#import Revit Nodes
clr.AddReference('RevitNodes')
import Revit
clr.ImportExtensions(Revit.Elements)

clr.AddReference('RevitServices')
import RevitServices
from RevitServices.Persistence import DocumentManager
from RevitServices.Transactions import TransactionManager

# Access the current Revit document
doc = DocumentManager.Instance.CurrentDBDocument

# Start a transaction
TransactionManager.Instance.EnsureInTransaction(doc)


# Get rooms using Dynamo's FilteredElementCollector
rooms = FilteredElementCollector(doc).OfCategory(BuiltInCategory.OST_Rooms).WhereElementIsNotElementType().ToElements()




# Define a function to set parameter by name
def SetParameterByName(element, parameterName, value):
    parameter_dict = []
    parameter = element.LookupParameter(parameterName)
    if parameter:
        parameter.Set(value)
        parameter_dict.append({parameterName, value})
    return parameter_dict  
   
   
resultElements =[]






# Loop through rooms and set parameters
for room in rooms:
    area = room.Area
    occup_load = round(area/100)
    
    resultElements.append(SetParameterByName(room, IN[1], occup_load))

# Commit the transaction
TransactionManager.Instance.TransactionTaskDone()

OUT = resultElements
# ----------------------------------------
watch_3 = Watch(python_script)
code_block_4 = CodeBlock { 500; }
code_block_5 = CodeBlock { "Ceiling Height"; }
python_script_2 = Python(IN[1]=code_block_4, IN[2]=code_block_5)  # CPython3; unwired: IN[0]
# ---------- python_script_2.python (48 lines) ----------
# Import necessary Dynamo libraries
import clr
clr.AddReference('RevitAPI')
from Autodesk.Revit.DB import FilteredElementCollector, BuiltInCategory, Transaction

#import Revit Nodes
clr.AddReference('RevitNodes')
import Revit
clr.ImportExtensions(Revit.Elements)

clr.AddReference('RevitServices')
import RevitServices
from RevitServices.Persistence import DocumentManager
from RevitServices.Transactions import TransactionManager

# Access the current Revit document
doc = DocumentManager.Instance.CurrentDBDocument

# Start a transaction
TransactionManager.Instance.EnsureInTransaction(doc)

# Get rooms using Dynamo's FilteredElementCollector
rooms = FilteredElementCollector(doc).OfCategory(BuiltInCategory.OST_Rooms).WhereElementIsNotElementType().ToElements()




# Define a function to set parameter by name
def SetParameterByName(element, parameterName, value):
    parameter_dict = []
    parameter = element.LookupParameter(parameterName)
    if parameter:
        parameter.Set(value)
        parameter_dict.append({parameterName, value})
    return parameter_dict  
   
   
resultElements =[]
# Loop through rooms and set parameters
for room in rooms:
    new_value = IN[1]
    
    resultElements.append(SetParameterByName(room, IN[2], new_value))

# Commit the transaction
TransactionManager.Instance.TransactionTaskDone()

OUT = resultElements
# ----------------------------------------
watch_4 = Watch(python_script_2)
parameters = Element.Parameters(element=all_elements_of_class)
watch_5 = Watch(parameters)
list_create = List.Create(item0=watch_5)
watch_6 = Watch(list_create)
watch_7 = Watch()  # unwired: arg0
wait = SynthesizeToolkit.Logic.Control.Wait(WaitFor=python_script, ContinueWith=ʳʰʸᵗʰᵐ_applications)
code_block_6 = CodeBlock { true; }
familydocument_close = Custom[FamilyDocument Close](document=wait, save=code_block_6)  # package Genius Loci; Close the given document with the option to save the changes.
watch_8 = Watch(familydocument_close)
