# Dynamo graph points by cartesian.dyn (Dynamo 2.18.1.5096)

string = StringInput("0,0,0;0,1,0;1,1,0;1,0,0;")
string_2 = StringInput(";")
string_3 = StringInput(",")
split = String.Split(string=string, separator0=string_2, separator1=string_3)
toNumber = String.ToNumber(string=split)
number = DoubleInput(3)
number_2 = DoubleInput(1)
takeEveryNthItem = List.TakeEveryNthItem(list=toNumber, n=number, offset=number_2)
number_3 = DoubleInput(2)
takeEveryNthItem_2 = List.TakeEveryNthItem(list=toNumber, n=number, offset=number_3)
number_4 = DoubleInput(0)
takeEveryNthItem_3 = List.TakeEveryNthItem(list=toNumber, n=number, offset=number_4)
byCartesianCoordinates = Point.ByCartesianCoordinates(x=takeEveryNthItem, y=takeEveryNthItem_2, z=takeEveryNthItem_3)
watch = Watch(byCartesianCoordinates)
watch_2 = Watch(toNumber)
code_block = CodeBlock { 175; 0; }
byARGB = Color.ByARGB(green=code_block.out1, blue=code_block.out0)
byARGB_2 = Color.ByARGB(alpha=code_block.out1, green=code_block.out1, blue=code_block.out1)
byARGB_3 = Color.ByARGB(red=code_block.out1, green=code_block.out0, blue=code_block.out0)
list_create = List.Create(item0=byARGB, item1=byARGB_2, item2=byARGB_3)
code_block_2 = CodeBlock { 0; 0.5; 1; }
list_create_2 = List.Create(item0=code_block_2.out0, item1=code_block_2.out1, item2=code_block_2.out2)
code_block_3 = CodeBlock { 0..1..#10; }
color_range = ColorRange(colors=list_create, indices=list_create_2, value=code_block_3)
code_block_4 = CodeBlock { -50..50..#5; }
code_block_5 = CodeBlock { -50..50..#10; }
watch_3 = Watch(code_block_5)
byCoordinates = Point.ByCoordinates(x=code_block_4, y=watch_3, lacing=CrossProduct)
watch_4 = Watch(byCoordinates)
code_block_6 = CodeBlock { 0..2; 0..3; }
watch_5 = Watch(code_block_6.out0)
watch_6 = Watch(code_block_6.out1)
byCoordinates_2 = Point.ByCoordinates(x=code_block_6.out0, y=code_block_6.out1, lacing=CrossProduct)
watch_7 = Watch(byCoordinates_2)
code_block_7 = CodeBlock { -250..-150..#4; }
byCoordinates_3 = Point.ByCoordinates(x=code_block_7, y=code_block_7, lacing=CrossProduct)
flatten = List.Flatten(list=byCoordinates_3)
byPoints = PolyCurve.ByPoints(points=flatten)
watch_8 = Watch(byPoints)
watch_9 = Watch(byCoordinates_3)
watch_10 = Watch(flatten)
code_block_8 = CodeBlock { 150; 20; }
byCoordinates_4 = Point.ByCoordinates(x=code_block_8.out0, y=code_block_8.out0)
byCoordinates_5 = Point.ByCoordinates(x=code_block_8.out0, y=code_block_8.out1)
byStartPointEndPoint = Line.ByStartPointEndPoint(startPoint=byCoordinates_4, endPoint=byCoordinates_5)
code_block_9 = CodeBlock { 0..0.5..#10; }
pointAtParameter = Curve.PointAtParameter(curve=byStartPointEndPoint, param=code_block_9)
code_block_10 = CodeBlock { 2; }
chop = List.Chop(list=pointAtParameter, lengths=code_block_10)
byBestFitThroughPoints = Line.ByBestFitThroughPoints(bestFitPoints=chop)
watch_11 = Watch(chop)
watch_12 = Watch(pointAtParameter)
watch_13 = Watch(byStartPointEndPoint)
