# Dynamo graph polka dot.dyn (Dynamo 2.18.1.5096)

code_block = CodeBlock {  }
XY = Plane.XY()
code_block_2 = CodeBlock { 100; }
byWidthLength = Rectangle.ByWidthLength(plane=XY, width=code_block_2, length=code_block_2)
byPatch = Surface.ByPatch(closedCurve=byWidthLength)
code_block_3 = CodeBlock { 0..1..#50; }
pointAtParameter = Surface.PointAtParameter(surface=byPatch, u=code_block_3, v=code_block_3, lacing=CrossProduct)
watch = Watch(pointAtParameter)
watch_2 = Watch(code_block_3)
number_slider = DoubleSlider(2, range=0..100 step 0.1)
number_slider_2 = DoubleSlider(8, range=0..100 step 0.1)
code_block_4 = CodeBlock(x=code_block_3, cycles=number_slider, amp=number_slider_2)
# ---------- code_block_4.designscript (3 lines) ----------
sineList=(0..Math.Sin(x*360*cycles)..#List.Count(x))*amp;
transposeList=List.Transpose(sineList);
eggSheelList=sineList+transposeList;
# ----------------------------------------
translate = Geometry.Translate(geometry=pointAtParameter, zTranslation=code_block_4.eggSheelList)
byPoints = NurbsSurface.ByPoints(points=translate)
code_block_5 = CodeBlock { 0..15..(1..5); }
watch_3 = Watch(code_block_5)
