# Dynamo graph setgetparameterplay.dyn (Dynamo 2.18.1.5096)

element_classes = ElementTypes("Wall")
all_elements_of_class = ElementsOfType(element_class=element_classes)
watch = Watch(all_elements_of_class)
parameters = Element.Parameters(element=watch)
watch_2 = Watch(parameters)
code_block = CodeBlock { "Area"; }
getParameterValueByName = Element.GetParameterValueByName(element=watch, parameterName=code_block)
watch_3 = Watch(getParameterValueByName)
code_block_2 = CodeBlock { "Area"; }
code_block_3 = CodeBlock { "Area"; }
code_block_4 = CodeBlock { [800]; }
python_script = Python(IN[0]=parameters, IN[1]=code_block_3, IN[2]=code_block_4)  # CPython3
# ---------- python_script.python (34 lines) ----------
# Get excel data
outcomesList = []
paramNames = IN[1]
excelData = IN[2]

for row in excelData:
    # Result for the row
    outcomes = []
    # Get the family
    famInd = famNames.index(row[0])
    famDoc = famDocs[famInd]
    # Get the type
    typeInd = famTypeNamesList[famInd].index(row[1])
    famType = famTypesList[famInd][typeInd]
    # Limit to just parameters
    values = row[2:]
    # Start a transaction
    t = Transaction(famDoc, row[0] + " - " + row[1])  # Corrected line
    t.Start()
    # Do some things
    for p, v in zip(paramNames, values):
        # Get the parameter
        parInd = famParamNamesList[famInd].index(p)
        famPar = famParamsList[famInd][parInd]
        # Set the Parameter
        setParam = famDoc_setParameter(famDoc, famPar, famType, v)
        outcomes.append(setParam)
    # Committing the transaction
    t.Commit()
    # Append the outcomes list
    outcomesList.append(outcomes)

# Declare output
OUT = outcomesList
# ----------------------------------------
