# Dynamo graph steps code block.dyn (Dynamo 2.18.1.5096)

code_block = CodeBlock { 0..5..(2..3); }
watch = Watch(code_block)
code_block_2 = CodeBlock { 0..#5..(1..3); }
watch_2 = Watch(code_block_2)
code_block_3 = CodeBlock { (0..1)..5..#2; }
watch_3 = Watch(code_block_3)
code_block_4 = CodeBlock { (0..1)..10..(2..3); }
watch_4 = Watch(code_block_4)
code_block_5 = CodeBlock { 0..(2..5)..1; }
watch_5 = Watch(code_block_5)
code_block_6 = CodeBlock { 0..(0..5)..2; }
watch_6 = Watch(code_block_6)
code_block_7 = CodeBlock { ["San Francisco", "New York", "Chicago"]; }
watch_7 = Watch(code_block_7)
code_block_8 = CodeBlock(cities=watch_7) { cities[2]; }
watch_8 = Watch(code_block_8)
